vi "802.11 FPGA STA.gvi"   [LabVIEW Communications System Design Suite 2.0.1]
panel controls:
  "reg.host read.go rcvd 0": bool
  "reg.notify host.go rcvd 0": bool
  "reg.reset 0": bool
  "RF 0/Rx/Enable": bool
  "RF 0/Tx/Enable": bool
  "RF 1/Rx/Enable": bool
  "RF 1/Tx/Enable": bool
  "ATR State": enum{"Idle", "Rx", "Tx", "Duplex"} = "Idle"
  "Radio Control Destination": T1 = "Radio 0 Config"
  "lo lpf enable": bool
  "power enable": bool
  "mixer enable": bool
  "tx.configuration": T2 = {"power enable"=TRUE, "mixer enable"=TRUE, "gain"=0}
  "RX data source": T3 = "RF"
  "packet start sample index": u16
  "rearm packet start generator": bool
  "bypass synchronization": bool
  "reset MAC RX statistics": bool
  "noise coefficient": FXP(8.8) = 10
  "mute RX while TX active?": bool = TRUE
  "number of samples to capture": u16 = 1024
  "produce silent samples": bool
  "MPDU filter config": T7 = {"remove header"=TRUE, "block unsupported frame types"=TRUE, "block FCS errors"=TRUE, "block address mismatch"=TRUE, "block header recognize error"=TRUE}
  "power calibration offset": FXP(10.3)
  "CCA energy detect threshold": FXP(10.3) = -62
  "RF gain": FXP(10.3)
  "number of samples before trigger": u16
  "synchronization settings": T8 = {"maximal normalization threshold"=65536, "peak timing metric threshold"=0.5, "consecutive samples over threshold"=10, "valley timing metric threshold"=-0.5, "consecutive samples under threshold"=10, "autocorelation threshold"=0.5, "expected peak valley distance"=608, "maximum peak valley distance deviation"=64, "samples to shift frame start"=-32, "use static CFO?"=FALSE, "static CFO"=0}
  "trigger condition": T9 = "Immediate"
  "manual trigger": bool
  "AGC tresholds": T10
  "AGC timeout": i32 = 3500
  "enable AGC": bool
  "manual PhyTxStart.req": cluster{"TX vector": T11, "Valid": bool}
  "bypass MAC TX": bool
  "RX TX turnaround time": u32 = 24
  "reset MAC TX statistics": bool
  "suppress ACK": bool
  "ACK bandwidth": enum{"20 MHz", "40 MHz", "80 MHz"} = "20 MHz"
  "rx.reset": bool = TRUE
  "rx.output sample rate": UFXP(1.47)
  "rx.delay": FXP(0.16)
  "rx 0.frequency shift": FXP(0.48)
  "rx 0.phase": FXP(0.21)
  "rx 0.impairments": T13 = {"inline gain I"=-1, "inline gain Q"=0.999992370605, "cross gain I"=0.999992370605, "cross gain Q"=0, "pre-gain offset I"=0, "pre-gain offset Q"=-1, "post-gain offset I"=0, "post-gain offset Q"=0.999992370605}
  "rx.abort": bool
  "tx.abort": bool
  "tx.reset": bool = TRUE
  "tx.input sample rate": UFXP(1.47)
  "tx.delay": FXP(0.18)
  "tx 0.frequency shift": FXP(0.48)
  "tx 0.phase": FXP(0.21)
  "tx 0.impairments": T13 = {"inline gain I"=0.999992370605, "inline gain Q"=0.999992370605, "post-gain offset I"=0.999992370605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}
  "tx 0.gain": T14 = {"gain I"=1, "gain Q"=1}
  "rx 1.impairments": T13 = {"inline gain I"=-0.999992370605, "inline gain Q"=0.999992370605, "cross gain I"=-0.999992370605, "cross gain Q"=0, "pre-gain offset I"=-1, "pre-gain offset Q"=0, "post-gain offset I"=0, "post-gain offset Q"=0}
  "rx 1.frequency shift": FXP(0.48)
  "rx 1.phase": FXP(0.21)
  "tx 1.impairments": T13 = {"inline gain I"=0.999992370605, "inline gain Q"=0.999992370605, "post-gain offset I"=-1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}
  "tx 1.frequency shift": FXP(0.48)
  "tx 1.phase": FXP(0.21)
  "tx 1.gain": T14 = {"gain I"=1, "gain Q"=1}
  "rx 0.stream enable": bool
  "rx 1.stream enable": bool
  "tx 0.stream enable": bool
  "tx 1.stream enable": bool
  "Data clock cycles per tick (0.1us)": u16 = 20
  "Data clock cycles per OFDM symbol": u16 = 480
  "rx.rf channel": UFXP(1.0)
  "tx.rf channel": UFXP(1.0)
  "enable DC offset correction": bool = TRUE
  "data clock locked?": bool
  "format": enum{"a", "ac"} = "a"
  "channel selector": UFXP(2.0)
  "device MAC address": u8[6]
  "DC centered signal": bool = TRUE
  "daughterboard": "niUsrpRio Config v1 Host.lvlib__DB Types.gtype" = "sbx"
  "antenna configuration": "niUsrpRio Config v1 Host.lvlib__Antenna Configuration.gtype" = "TX1 RX1 transmits and RX2 receives"
  "spi address": u8 = 7
  "cpld enable": bool = TRUE
  "time to wait for decoding packet": u32
  "CW Max": u16
  "CW Min": u16
  "Fixed backoff?": bool
  "Exponential Backoff Ratio": UFXP(6.10)
  "Fixed backoff value": u16
  "Backoff: Fixed Backoff Value": "U16 Register Names Enum.gtype" = "CW Max"
  "Backoff: CW Max": "U16 Register Names Enum.gtype" = "CW Max"
  "Backoff: Exponential Backoff Ratio": "FXP 6.10 Register Names Enum.gtype" = "Default"
  "Backoff: CW Min": "U16 Register Names Enum.gtype" = "CW Max"
  "Backoff: Fixed Backoff?": "Boolean Register Names Enum.gtype" = "Default"
  "Set Backoff Done Pulse to False": bool
  "Piggyback: Piggyback Address": "MAC Address Register Names.gtype" = "Default"
  "Piggyback: Enable Piggyback": "Boolean Register Names Enum.gtype" = "Default"
  "Enable Piggyback": bool
  "Use RTR instead of Data?": bool
  "Input: chain table": u64[8]
  "Host queue length (packets)": u32
  "Queue threshold for contention": u32
  "packet size (bytes)": u32
  "reset permission to contend": bool
  "Qchain:DIFS after ACK done (manual)": bool
  "Qchain:Use manual for DIFS after ACK done?": bool
  "Qchain:DIFS in global clock ticks": u32 = 340
  "Queue threshold for withdrawal (packets)": u32
  "Use manual Qchain withdrawal?": bool
  "manual Qchain withdrawal": bool
  "Qchain:id increment": u8 = 2
  "time for starting tracking": u32
  "Qchain: Manual enable for node departure": bool
panel indicators:
  "reg.notify host.go 0": bool
  "reg.host read.data 0": cluster{"go": bool, "data": u32}
  "compensated CFO": FXP(0.48)
  "MAC RX statistics": T4
  "PhyRxStart.ind": T5
  "PhyRxEnd.ind": T6
  "T2H RX Data overflow": u16
  "T2H Constallation overflow": u16
  "T2H RX Bit Processing Output FIFO overflow": u16
  "T2H RX Power Spectrum overflow": u16
  "T2H Channel Estimation overflow": u16
  "last applied gain": UFXP(5.1)
  "RF input power at packet start": FXP(10.3)
  "signal power at packet start": FXP(10.3)
  "RF input power": FXP(10.3)
  "signal power": FXP(10.3)
  "out of range?": bool
  "MAC TX statistics": T12
  "PhyTxStart.req": cluster{"TX vector": T11, "Valid": bool}
  "PhyTxEnd.ind": cluster{"Valid": bool}
  "internal loopback FIFO overflow": u16
  "TX to RF FIFO overflow": u16
  "T2H TX Baseband FIFO overflow": u16
  "T2H TX Bit Processing Output FIFO overflow": u16
  "rx.samples processed": u32
  "rx.number of IQ data overflows": u64
  "rx.number of overflows": u32
  "tx.samples processed": u32
  "tx.underflows": u32
  "tx.number of IQ data overflows": u64
  "rx.dsp reset done": bool
  "tx.dsp reset done": bool
  "tx.state": "Stream Control State.gtype"
  "rx.state": "Stream Control State.gtype"
  "Timestamp": u32
  "DC average": CFXP(1.17)
  "CW and Backoff Indicators": T15
  "Qchain:data after sifs count": u32
  "enable piggyback register": u32
  "count piggyback": u32
  "Has been transferred?": bool
  "ID table": u8[8]
  "Chain Table": u64[8]
  "Is header?": bool
  "Order in Chain": u8
  "Head Mac Address": u8[6]
  "PiggyBack Address": u8[6]
  "Check if it is matching?": bool
  "Check the ID": u8
  "Index of Max ID": i32
  "Piggy": u64
  "authorized to contend?": bool
  "FPGA queue length": u32
  "Qchain:count DIFS after ACK done": u32
  "Qchain:count TX after backoff done": u32
  "Qchain:count CCA idle for DIFS time": u32
  "Qchain:DIFS count": u32
  "Qchain:state": T16
  "Qchain:count fast piggyback": u32
  "Qchain:count fast piggyback trigger": u32
  "Fastpiggyback Timestamp": u32
  "Fastpiggyback at Idle Timestamp": u32
  "Qchain:count fast piggyback trigger at idle": u32
  "Indicator for Qchain tracking": u8[8]
types:
  T1 = enum{"Identification", "Board Config", "Global Config", "Radio 0 Config", "Radio 1 Config", "Synchronization", "Time", "Future Events"}
  T2 = cluster{"power enable": bool, "mixer enable": bool, "gain": u8}
  T3 = enum{"RF", "BB Data From Host", "Internal Loopback"}
  T4 = cluster{"number of frames detected": u32, "number of subframes received": u32, "number of valid subframes received": u32, "number of ACKs received": u32, "valid": bool}
  T5 = cluster{"Format": enum{"a", "ac"}, "Bandwidth": enum{"20 MHz", "40 MHz", "80 MHz"}, "PSDU Length": u32, "MCS": UFXP(4.0), "valid": bool}
  T6 = cluster{"Format Violation": bool, "Timing valid": bool, "Timing value": u32, "valid": bool}
  T7 = cluster{"remove header": bool, "block unsupported frame types": bool, "block FCS errors": bool, "block address mismatch": bool, "block header recognize error": bool}
  T8 = cluster{"maximal normalization threshold": UFXP(19.15), "peak timing metric threshold": FXP(2.6), "consecutive samples over threshold": u8, "valley timing metric threshold": FXP(2.6), "consecutive samples under threshold": u8, "autocorelation threshold": UFXP(2.14), "expected peak valley distance": u16, "maximum peak valley distance deviation": u8, "samples to shift frame start": i8, "use static CFO?": bool, "static CFO": FXP(0.48)}
  T9 = enum{"Immediate", "RX Packet Start", "TX Paket Start", "CCA energy detected"}
  T10 = cluster{"AGC active threshold": FXP(10.3), "AGC threshold 1": FXP(10.3), "AGC threshold 2": FXP(10.3), "AGC threshold 3": FXP(10.3)}
  T11 = cluster{"format": enum{"a", "ac"}, "bandwidth": enum{"20 MHz", "40 MHz", "80 MHz"}, "length": u32, "MCS": UFXP(4.0), "TX power level": UFXP(4.0), "Scrambler seed": UFXP(7.0)}
  T12 = cluster{"number of TX after SIFS requests detected": u32, "number of TX after SIFS requests completed": u32, "number of TX after backoff requests detected": u32, "number of TX after backoff requests completed": u32}
  T13 = cluster{"inline gain I": FXP(1.17), "inline gain Q": FXP(1.17), "cross gain I": FXP(1.17), "cross gain Q": FXP(1.17), "pre-gain offset I": FXP(1.17), "pre-gain offset Q": FXP(1.17), "post-gain offset I": FXP(1.17), "post-gain offset Q": FXP(1.17)}
  T14 = cluster{"gain I": FXP(3.21), "gain Q": FXP(3.21)}
  "Stream Control State.gtype" = enum{"Idle", "Active"}
  "niUsrpRio Config v1 Host.lvlib__DB Types.gtype" = enum{"sbx", "cbx", "wbx", "unknown", "ubx"}
  "niUsrpRio Config v1 Host.lvlib__Antenna Configuration.gtype" = enum{"TX1 RX1 transmits and RX2 receives", "TX1 RX1 receives and RX2 is unused"}
  T15 = cluster{"CW": u16, "Last CWs": u16[30], "Last Backoffs": u16[30], "Last Random Numbers": UFXP(0.16)[30]}
  "U16 Register Names Enum.gtype" = enum{"Default", "CW Max", "CW Min", "Fixed Backoff Value", "Backoff"}
  "FXP 6.10 Register Names Enum.gtype" = enum{"Default", "Exponential Backoff Ratio"}
  "Boolean Register Names Enum.gtype" = enum{"Default", "Fixed Backoff?", "Enable Piggyback?"}
  "MAC Address Register Names.gtype" = enum{"Default", "Piggyback MAC Address"}
  T16 = enum{"\"First time into the chain\"", "\"First time to update the id table\"", "\"Update the id table again\"", "\"Withdraw from Qchain and reset Qchain ID\""}
  "Cluster Constant.gtype" = cluster{"CW Max Reg": RegisterDataType<u16>, "CW Min Reg": RegisterDataType<u16>, "Fixed Backoff Value Reg": RegisterDataType<u16>, "Backoff": RegisterDataType<u16>, "Exponential Backoff Ratio Reg": RegisterDataType<UFXP(6.10)>, "Fixed Backoff Reg": RegisterDataType<bool>, "U16 Default": RegisterDataType<u16>, "FXP <6.10> Default": RegisterDataType<UFXP(6.10)>, "Boolean Default": RegisterDataType<bool>, "Has been transferred?": RegisterDataType<bool>, "If is the header?": RegisterDataType<bool>}
  T17 = cluster{"MPDU subtype": enum{"ACK"}, "destination MAC address": u8[6], "valid": bool}
  T18 = cluster{"CCA energy detection busy": u8, "CCA signal detection busy": bool, "frame timing valid": bool, "frame timing value": u32, "frame timing use DIFS": bool}
  T19 = cluster{"5 MHz": bool, "10 MHz": bool, "20 MHz": bool, "40 MHz": bool, "80 Mhz": bool, "160 MHz": bool}
  T20 = cluster{"format": enum{"a", "ac"}, "channel selector": UFXP(2.0), "device MAC address": u8[6], "DC centered signal": bool, "supported bandwidths": T19}
  T21 = cluster{"global timestamp": RegisterDataType<u32>, "OFDM symbol pulse": RegisterDataType<bool>, "TX active": RegisterDataType<bool>, "channel state indication": RegisterDataType<T18>, "MPDU generation request": RegisterDataType<T17>, "shared properties": RegisterDataType<T20>}
  T22 = cluster{"CCA energy detection busy": u8, "CCA signal detection busy": bool}
  T23 = enum{"Idle", "Wait for second measurement", "AGC active", "Gain locked"}
  T24 = cluster{"trigger gain setting": bool, "gain": UFXP(5.1)}
  "802.11 PHY-SAP.gtype" = cluster{"PSDU (RX)": any, "PSDU (TX)": any, "CCA detection": RegisterDataType<T22>, "PhyRxStart.req": HandshakeDataType<T5>, "PhyRxEnd.ind": HandshakeDataType<T6>, "channel state indication": HandshakeDataType<T18>, "PhyTxStart.req": HandshakeDataType<cluster{"TX vector": T11, "Valid": bool}>, "PhyTxEnd.ind": HandshakeDataType<cluster{"Valid": bool}>, "PHY RX AGC state indication": HandshakeDataType<cluster{"AGC state": T23, "AGC enabled": bool}>, "PHY RX Gain change indication": HandshakeDataType<T24>}
  T25 = cluster{"RF to RX FIFO": any, "internal loopback FIFO": any, "TX to RF FIFO": any, "Gain Settings FIFO": any}
  T26 = cluster{"output sample rate": UFXP(1.47), "delay": FXP(0.16), "frequency shift": FXP(0.48), "impairments": T13, "phase": FXP(0.21)}
  T27 = cluster{"frequency shift": FXP(0.48), "impairments": T13, "phase": FXP(0.21), "input sample rate": UFXP(1.47), "gain": T14, "delay": FXP(0.18)}
diagram:
  Register Create(initial value=1024) -> (reference out=w1)
  Register Create(initial value=8) -> (reference out=w2)
  Register Create(initial value=4) -> (reference out=w3)
  Register Create(initial value=0) -> (reference out=w4)
  Register Create(initial value=0) -> (reference out=w5)
  Register Create(initial value=FALSE) -> (reference out=w6)
  Register Create(initial value=0) -> (reference out=w7)
  Register Create(initial value=0) -> (reference out=w8)
  Register Create(initial value=FALSE) -> (reference out=w9)
  Register Create(initial value=FALSE) -> (reference out=w10)
  Register Create(initial value=FALSE) -> (reference out=w11)
  Property Node(instance in="Cluster Constant.gtype" {all zero or empty}, "CW Max Reg"=w1, "CW Min Reg"=w2, "Fixed Backoff Value Reg"=w3, "Backoff"=w4, "Exponential Backoff Ratio Reg"=w5, "Fixed Backoff Reg"=w6, "U16 Default"=w7, "FXP <6.10> Default"=w8, "Boolean Default"=w9, "Has been transferred?"=w10, "If is the header?"=w11) -> (instance out=w12)
  Register Create(initial value=0) -> (reference out=w13)
  Register Create(initial value=FALSE) -> (reference out=w14)
  w15 = T17 {"MPDU subtype"="ACK", "destination MAC address"=[0, 0, 0, 0, 0, 0], "valid"=FALSE}
  Register Create(initial value=w15) -> (reference out=w16)
  Register Create(initial value=FALSE) -> (reference out=w17)
  Register Create(initial value=T18 {all zero or empty}) -> (reference out=w18)
  w19 = T20 {"format"="a", "channel selector"=0, "device MAC address"=[0, 0, 0, 0, 0, 0], "DC centered signal"=FALSE, "supported bandwidths"={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}}
  Register Create(initial value=w19) -> (reference out=w20)
  Property Node(instance in=T21 {all zero or empty}, "global timestamp"=w13, "MPDU generation request"=w16, "channel state indication"=w18, "TX active"=w17, "OFDM symbol pulse"=w14, "shared properties"=w20) -> (instance out=w21)
  FIFO Create(data type=u8 0) -> (reference out=w22)
  FIFO Create(data type=u8 0) -> (reference out=w23)
  Register Create(initial value=T22 {all zero or empty}) -> (reference out=w24)
  Handshake Create(data type=T5 {all zero or empty}) -> (reference out=w25)
  Handshake Create(data type=T6 {all zero or empty}) -> (reference out=w26)
  Handshake Create(data type=T18 {all zero or empty}) -> (reference out=w27)
  Handshake Create(data type=cluster{"TX vector": T11, "Valid": bool} {all zero or empty}) -> (reference out=w28)
  Handshake Create(data type=cluster{"Valid": bool} {all zero or empty}) -> (reference out=w29)
  w30 = cluster{"AGC state": T23, "AGC enabled": bool} {all zero or empty}
  Handshake Create(data type=w30) -> (reference out=w31)
  Handshake Create(data type=T24 {all zero or empty}) -> (reference out=w32)
  Property Node(instance in="802.11 PHY-SAP.gtype" {all zero or empty}, "PSDU (RX)"=w22, "PSDU (TX)"=w23, "CCA detection"=w24, "PhyRxStart.req"=w25, "PhyRxEnd.ind"=w26, "channel state indication"=w27, "PhyTxStart.req"=w28, "PhyTxEnd.ind"=w29, "PHY RX AGC state indication"=w31, "PHY RX Gain change indication"=w32) -> (instance out=w33)
  clock-driven loop (clock = "802.11 AFW Resources.grsc\\MACSLOW") (after w12) forever {
    call "802.11 PHY-SAP Read MAC.gcdl"(PHY-SAP=w33) -> (CCA detection=w34, PSDU=w35, PSDU valid=w36, PhyRxStart.req=w37, PhyTxEnd.ind=w38, PhyRxEnd.ind=w39, PHY RX AGC state indication=w40, PHY RX Gain change indication=w41)
    Property Node(instance in=w21) -> ("shared properties"=w42, "global timestamp"=w43, "channel state indication"=w44)
    Register Read(reference in=w43) -> (data=w45)
    # w34: CCA detection
    call "Piggyback.gcdl"(Piggyback: Piggyback Address=$"Piggyback: Piggyback Address", Piggyback: Enable Piggyback=$"Piggyback: Enable Piggyback") -> (Piggyback Address=w46, Piggyback Enable?=w47)
    Property Node(instance in=w37) -> ("valid"=w48)
    Feedback Node(enable?=w48, initial value=u8[6] default, input=w49) -> w50
    Feedback Node(input=w51) -> w52
    Property Node(instance in="802.11 AFW Resources.grsc\\H2T TX Data") -> ("used elements"=w53)
    call "manage Qchain withdrawal.gcdl"(Host queue length (packets)=$"Host queue length (packets)", FPGA queue length (bytes)=w53, Queue threshold for withdrawal (packets)=$"Queue threshold for withdrawal (packets)", packet size (bytes)=$"packet size (bytes)", Use manual Qchain withdrawal?=$"Use manual Qchain withdrawal?", manual Qchain withdrawal=$"manual Qchain withdrawal") -> (Qchain withdrawal=w54)
    call "802.11 MAC RX.gcdl"(PSDU=w35, input valid=w36, PHY RX start indication=w37, PHY RX end indication=w39, PHY CCA timing indication=w34, reset MAC RX statistics=$"reset MAC RX statistics", device MAC address=w50, MPDU filter config=$"MPDU filter config", Enable Piggyback=w47, piggyback MAC address=w46, Qchain:DIFS after ACK done=w52, global clock counter=w45, Input: chain table=$"Input: chain table", Qchain:DIFS in global clock ticks=$"Qchain:DIFS in global clock ticks", Qchain withdrawal?=w54, Qchain:id increment=$"Qchain:id increment", Manual enable for Qchain node departure=$"Qchain: Manual enable for node departure") -> (MAC RX statistics=w55, channel state indication=w56, ICP SDU=w57, output valid=w58, MPDU generation request=w59, ACK Received Pulse=w60, Piggyback?=w61, Qchain:count DIFS after ACK done=w62, Qchain:state=w63, Qchain:count fast piggyback=w64, Qchain:count fast piggyback trigger=w65, Qchain:count fast piggyback trigger at idle=w66)
    $"Qchain:count DIFS after ACK done" <- w62
    $"Qchain:state" <- w63
    call "802.11 RX Data Sink.gcdl"(ICP SDU=w57, input valid=w58, FIFO reference="802.11 AFW Resources.grsc\\T2H RX Data") -> (FIFO overflow count=w67)
    $"T2H RX Data overflow" <- w67
    # w59: MPDU request
    Register Write(data=w56, reference in=w44) -> (reference out=w68)
    # w45: global time reference
    Register Read(reference in=w68) -> (data=w69)
    Register Read(reference in=w42) -> (data=w70)
    # w33: PHY SAP
    Property Node(instance in=w70) -> ("format"=w71, "device MAC address"=w49)
    # w68: channel state indication
    Feedback Node(input=w72) -> w73
    # w74: TX Data after SIFS
    call "802.11 Prepare ACK.gcdl"(format=w71, bandwidth=$"ACK bandwidth", MPDU generation request=w59, MAC ready=w73, suppress=$"suppress ACK") -> (MPDU block=w75, output valid=w76, TX after SIFS request=w77, TX Data After SIFS=w74)
    Register Read(reference in="802.11 AFW Resources.grsc\\Backoff") -> (data=w78)
    call "manage permission to contend.gcdl"(Host queue length (packets)=$"Host queue length (packets)", FPGA queue length (bytes)=w53, Queue threshold for contention (packets)=$"Queue threshold for contention", packet size (bytes)=$"packet size (bytes)", manual reset permission to contend=$"reset permission to contend", Qchain withdrawal pulse=w54) -> (authorized to contend?=w79)
    Feedback Node(input=w80) -> w81
    call "802.11 TX Data Source.gcdl"(ready for output=w81, H2T TX Data="802.11 AFW Resources.grsc\\H2T TX Data", bypass MAC TX=$"bypass MAC TX") -> (ICP data=w82, output valid=w83, elements available=w84)
    Feedback Node(input=w85) -> w86
    Feedback Node(input=w87) -> w88
    call "802.11 Prepare MPDU.gcdl"(ICP=w82, input valid=w83, elements available=w84, MAC ready for input=w86, TX status indication=w88, backoff value=w78, Use RTR instead of Data?=$"Use RTR instead of Data?", authorized to contend?=w79) -> (MPDU block=w89, ready for input=w80, output valid=w90, TX after backoff request=w91)
    Logical Or(w75, w89) -> w92
    Logical Or(w76, w90) -> w93
    Feedback Node(input=w94) -> w95
    call "802.11 MAC TX.gcdl"(TX after backoff request=w91, TX after SIFS request=w77, channel state indication=w69, global clock value=w45, RX TX turnaround time in global clock ticks=$"RX TX turnaround time", PSDU data ready for input=w95, PHY TX end indication=w38, MPDU block=w92, input valid=w93, reset MAC TX statistics=$"reset MAC TX statistics", Set Backoff Done Pulse to False=$"Set Backoff Done Pulse to False", TX Data After SIFS=w74, time for starting tracking=$"time for starting tracking") -> (MPDU=w96, output valid=w97, PHY TX start request=w98, TX after SIFS data ready for input=w72, TX after backoff data ready for input=w85, TX status indication=w87, MAC TX statistics=w99, TX after backoff done=w100, Qchain:data after sifs count=w101, Qchain:count TX after backoff done=w102, Qchain:DIFS done pulse=w103, Qchain:DIFS count=w104)
    call "802.11 TX MAC Bypass.gcdl"(ready for output=w95, TX data FIFO reference="802.11 AFW Resources.grsc\\H2T TX Data", bypass MAC TX=$"bypass MAC TX", manual PhyTxStart.req=$"manual PhyTxStart.req", MPDU=w96, input valid=w97, request in=w98) -> (PSDU=w105, output valid=w106, request out=w107)
    call "802.11 PHY-SAP Write MAC.gcdl"(PHY-SAP=w33, PhyTxStart.req=w107, PSDU=w105, PSDU valid=w106, channel state indication=w56) -> (PSDU TX ready for input=w94)
    $"MAC RX statistics" <- w55
    # w54: Qchain withdrawal?
    Feedback Node(input=w100) -> w108
    call "Check ACK Received.gcdl"(ACK Received Pulse In=w60, TX after backoff done=w108, time to wait for decoding packet=$"time to wait for decoding packet", global clock counter=w45) -> (ACK Received out=w109, valid?=w110)
    FIFO Write(Control Protocol Input=w110, data=w109, reference in="802.11 AFW Resources.grsc\\ACK Received FIFO")
    call "niInstr Basic Elements v1 FPGA.lvlib__Count Up U32.gcdl"(increment=w61) -> (count out=w111)
    $"count piggyback" <- w111
    $"MAC TX statistics" <- w99
    $"Qchain:DIFS count" <- w104
    $"Qchain:data after sifs count" <- w101
    $"Qchain:count TX after backoff done" <- w102
    $"FPGA queue length" <- w53
    call "niInstr Basic Elements v1 FPGA.lvlib__Count Up U32.gcdl"(increment=w47) -> (count out=w112)
    # w37: PHY RX start indication
    # w39: PHY RX end indication
    # w41: PHY RX Gain change indication
    $"enable piggyback register" <- w112
    # w40: PHY RX AGC state indication
    call "802.11 Write RX Events.gcdl"(global timestamp=w45, PHY RX start indication=w37, PHY RX end indication=w39, MAC channel state indication=w56, PHY CCA timing indication=w34, T2H FIFO reference="802.11 AFW Resources.grsc\\T2H Events", PHY RX Gain change indication=w41, PHY RX AGC state indication=w40)
    call "Track CCA Busy.gcdl"(global clock counter=w45)
    call "802.11 Capture PHY TX Indications.gcdl"(PHY TX end indication in=w38, PHY TX start request in=w107) -> (PHY TX start request out=w113, PHY TX end indication out=w114)
    $"PhyTxStart.req" <- w113
    $"authorized to contend?" <- w79
    $"PhyTxEnd.ind" <- w114
    call "802.11 Write TX Events.gcdl"(global time reference=w45, PHY TX end indication=w38, PHY TX start request=w107, TX status indication=w87, T2H FIFO reference="802.11 AFW Resources.grsc\\T2H Events")
    # w38: PhyTxEnd.ind
    call "Reset to next Chain.gcdl"(TX after backoff done=w108, slot M2 end pulse=w103, Use manual for DIFS after ACK done?=$"Qchain:Use manual for DIFS after ACK done?", global clock counter=w45, DIFS after ACK done (manual)=$"Qchain:DIFS after ACK done (manual)", Qchain:DIFS in global clock ticks=$"Qchain:DIFS in global clock ticks") -> (DIFS after ACK done=w51, count CCA idle for DIFS time=w115)
    $"Qchain:count CCA idle for DIFS time" <- w115
    $"Qchain:count fast piggyback" <- w64
    $"Qchain:count fast piggyback trigger" <- w65
    $"Qchain:count fast piggyback trigger at idle" <- w66
    call "Backoff Block.gcdl"(Backoff: CW Max=$"Backoff: CW Max", Backoff: Exponential Backoff Ratio=$"Backoff: Exponential Backoff Ratio", Backoff: CW Min=$"Backoff: CW Min", Backoff: Fixed Backoff Value=$"Backoff: Fixed Backoff Value", Backoff: Fixed Backoff?=$"Backoff: Fixed Backoff?") -> (CW and Backoff Indicators=w116)
    $"CW and Backoff Indicators" <- w116
    Register Read(reference in="802.11 AFW Resources.grsc\\Has been transferred?") -> (data=w117)
    $"Has been transferred?" <- w117
    Register Read(reference in="802.11 AFW Resources.grsc\\Piggy") -> (data=w118)
    $Piggy <- w118
    # w103: DIFS done pulse
    Register Read(reference in="802.11 AFW Resources.grsc\\Head Mac Address") -> (data=w119)
    $"Head Mac Address" <- w119
    Register Read(reference in="802.11 AFW Resources.grsc\\ID Table") -> (data=w120)
    $"ID table" <- w120
    Register Write(data=$"Input: chain table", reference in="802.11 AFW Resources.grsc\\Chain Table")
    Register Write(data=$"Fixed backoff?", reference in="802.11 AFW Resources.grsc\\Fixed Backoff?")
    Register Write(data=$"CW Max", reference in="802.11 AFW Resources.grsc\\CW Max")
    Register Read(reference in="802.11 AFW Resources.grsc\\Indicator for Qchain tracking") -> (data=w121)
    $"Indicator for Qchain tracking" <- w121
    Register Write(data=$"Exponential Backoff Ratio", reference in="802.11 AFW Resources.grsc\\Exponential Backoff Ratio")
    Register Read(reference in="802.11 AFW Resources.grsc\\Piggyback Address") -> (data=w122)
    $"PiggyBack Address" <- w122
    Register Write(data=$"CW Min", reference in="802.11 AFW Resources.grsc\\CW Min")
    Register Read(reference in="802.11 AFW Resources.grsc\\Chain Table") -> (data=w123)
    $"Chain Table" <- w123
    Register Write(data=$"Enable Piggyback", reference in="802.11 AFW Resources.grsc\\Enable Piggyback?")
    Register Write(data=$"Fixed backoff value", reference in="802.11 AFW Resources.grsc\\Fixed Backoff Value")
    Register Read(reference in="802.11 AFW Resources.grsc\\Check if it is matching?") -> (data=w124)
    $"Check if it is matching?" <- w124
    Register Read(reference in="802.11 AFW Resources.grsc\\Order ID in chain") -> (data=w125)
    $"Order in Chain" <- w125
    call "check if is the head of chain.gcdl"(Order in the Chain=w125) -> (Is header?=w126)
    $"Is header?" <- w126
    Register Read(reference in="802.11 AFW Resources.grsc\\Check the ID") -> (data=w127)
    $"Check the ID" <- w127
    Register Read(reference in="802.11 AFW Resources.grsc\\Fastpiggyback Timestamp") -> (data=w128)
    $"Fastpiggyback Timestamp" <- w128
    Register Read(reference in="802.11 AFW Resources.grsc\\Max ID") -> (data=w129)
    $"Index of Max ID" <- w129
    Register Read(reference in="802.11 AFW Resources.grsc\\Fastpiggyback at Idle Timestamp") -> (data=w130)
    $"Fastpiggyback at Idle Timestamp" <- w130
  }
  FIFO Create(data type=CFXP(3.13) 0+0i, depth=17) -> (reference out=w131)
  FIFO Create(data type=CFXP(3.13) 0+0i, depth=1025) -> (reference out=w132)
  FIFO Create(data type=CFXP(3.13) 0+0i, depth=1025) -> (reference out=w133)
  FIFO Create(data type=UFXP(5.1) 0, depth=17) -> (reference out=w134)
  Property Node(instance in=T25 {all zero or empty}, "RF to RX FIFO"=w131, "internal loopback FIFO"=w132, "TX to RF FIFO"=w133, "Gain Settings FIFO"=w134) -> (instance out=w135)
  clock-driven loop (clock = "802.11 AFW Resources.grsc\\PHY") forever {
    Property Node(instance in=w21) -> ("global timestamp"=w136, "shared properties"=w137, "TX active"=w138, "OFDM symbol pulse"=w139)
    Register Read(reference in=w136) -> (data=w140)
    Property Node(instance in=w135) -> ("RF to RX FIFO"=w141, "internal loopback FIFO"=w142, "TX to RF FIFO"=w143, "Gain Settings FIFO"=w144)
    Register Read(reference in=w139) -> (data=w145, reference out=w146)
    Register Read(reference in=w137) -> (data=w147)
    # w145: Symbol trigger
    Property Node(instance in=w147) -> ("supported bandwidths"=w148, "DC centered signal"=w149, "channel selector"=w150)
    Feedback Node(input=w151) -> w152
    call "802.11 PHY-SAP Read PHY.gcdl"(PHY-SAP=w33, ready for output=w152) -> (PSDU=w153, PSDU valid=w154, PhyTxStart.req=w155)
    call "niInstr Basic Elements v1 FPGA.lvlib__Detect Rising Edge.gcdl"(signal=w145) -> (edge detected=w156)
    call "802.11 PHY TX Request Handler.gcdl"(symbol trigger in=w156, PhyTxStart.req=w155, supported bandwidths=w148) -> (symbol index=w157, symbol trigger out=w158, start of packet=w159, TX vector out=w160, PhyTxEnd.ind=w161, TX active=w162)
    Register Write(data=w162, reference in=w138) -> (reference out=w163)
    call "802.11 RX Data Source.gcdl"(RX data source=$"RX data source", mute RX while TX active?=$"mute RX while TX active?", TX active register=w163, RF to RX FIFO=w141, internal loopback FIFO=w142, OFDM symbol trigger register=w146, produce silent samples=$"produce silent samples", H2T FIFO="802.11 AFW Resources.grsc\\H2T RX Baseband") -> (sample=w164, output valid=w165)
    call "802.11 Signal Filter.gcdl"(sample in=w164, input valid=w165, configuration=w147) -> (20MHz sample out=w166, output valid=w167, 40MHz sample out=w168, 80MHz sample out=w169)
    Feedback Node(input=w170) -> w171
    call "802.11 Synchronization.gcdl"(bypass synchronization=$"bypass synchronization", rearm packet start generator=$"rearm packet start generator", packet start sample index=$"packet start sample index", synchronization settings=$"synchronization settings", rearm sychronization=w171, sample in=w164, input valid=w165, filtered sample=w166, filtered sample valid=w167) -> (sample out=w172, output valid=w173, packet start=w174, compensated CFO=w175, CCA signal detected=w176)
    w177 = T20 {"format"="a", "channel selector"=0, "device MAC address"=[0, 0, 0, 0, 0, 0], "DC centered signal"=FALSE, "supported bandwidths"={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}}
    Feedback Node(enable?=w174, initial value=w177, input=w147) -> w178
    Property Node(instance in=w178) -> ("format"=w179, instance out=w180)
    Feedback Node(input=w181) -> w182
    call "802.11 RX IQ Processing.gcdl"(sample=w172, input valid=w173, packet start=w174, configuration=w182) -> (subcarrier=w183, subcarrier timing=w184, subcarrier field map=w185, last sample received=w186, channel estimate=w187, channel estimate timing=w188)
    Feedback Node(input=w189) -> w190
    call "802.11 RX Bit Processing.gcdl"(subcarrier timing=w184, subcarrier=w183, field map=w185, configuration=w190, noise coefficient=$"noise coefficient") -> (current OFDM symbol=w191, PSDU=w192, bit=w193, bit valid=w194, last byte decoded=w195, PSDU valid=w196)
    call "802.11 RX PHY State Machine.gcdl"(bit=w193, bit valid=w194, shared properties=w180, current OFDM symbol=w191, last bit of packet decoded=w195, last sample of packet received=w186, global timestamp=w140) -> (RX bit processing configuration=w189, RX IQ processing configuration=w181, PhyRxStart.ind=w197, PhyRxEnd.ind=w198)
    Property Node(instance in=w198) -> ("valid"=w170)
    Feedback Node(input=w199) -> w200
    To Fixed Point(number=w200) -> w201: FXP(10.3) Saturate:ConvergentRounding
    Select(s=$"enable AGC", t=w201, f=$"RF gain") -> w202
    call "802.11 Power Measurement.gcdl"(sample=w169, input valid=w167, CCA energy detect threshold=$"CCA energy detect threshold", power calibration offset=$"power calibration offset", RF gain=w202, sample 20MHz filtered=w166, sample 40MHz filtered=w168) -> (signal power=w203, output valid=w204, out of range?=w205, CCA energy detect=w206, RF input power=w207)
    Property Node(instance in=T22 {all zero or empty}, "CCA energy detection busy"=w206, "CCA signal detection busy"=w176) -> (instance out=w208)
    call "802.11 AGC.gcdl"(signal power=w203, packet start=w174, rearm AGC=w171, AGC thresholds=$"AGC tresholds", AGC timeout=$"AGC timeout", signal power valid=w204, enable AGC=$"enable AGC") -> (gain=w209, trigger gain setting=w210, state=w211, last applied gain=w199)
    Property Node(instance in=T24 {all zero or empty}, "trigger gain setting"=w210, "gain"=w209) -> (instance out=w212)
    w213 = cluster{"AGC state": T23, "AGC enabled": bool} {all zero or empty}
    Property Node(instance in=w213, "AGC state"=w211, "AGC enabled"=$"enable AGC") -> (instance out=w214)
    call "802.11 PHY-SAP Write PHY.gcdl"(PHY-SAP=w33, PSDU valid=w196, PSDU=w192, CCA detection=w208, PhyRxEnd.ind=w198, PhyRxStart.ind=w197, PhyTxEnd.ind=w161, PHY RX Gain change indication=w212, PHY RX AGC state indication=w214)
    call "802.11 Prepare RX IQ Data for T2H.gcdl"(subcarrier=w183, timing=w184, field map=w185, FIFO reference="802.11 AFW Resources.grsc\\T2H Constellation") -> (FIFO overflow count=w215)
    $"T2H Constallation overflow" <- w215
    call "802.11 Prepare Channel Estimation for T2H.gcdl"(channel estimate=w187, timing=w188, format=w179, FIFO reference="802.11 AFW Resources.grsc\\T2H Channel Estimation") -> (FIFO overflow count=w216)
    $"T2H Channel Estimation overflow" <- w216
    call "802.11 Trigger Capture RX Samples.gcdl"(trigger condition=$"trigger condition", manual trigger=$"manual trigger", RX packet start=w174, TX active register=w163, CCA energy detected=w206) -> (trigger=w217)
    call "802.11 Capture RX Samples.gcdl"(sample=w172, input valid=w173, trigger=w217, number of samples to capture=$"number of samples to capture", FIFO reference="802.11 AFW Resources.grsc\\T2H RX Power Spectrum", number of samples before trigger=$"number of samples before trigger") -> (FIFO overflow count=w218)
    $"T2H RX Power Spectrum overflow" <- w218
    call "802.11 TX Bit Processing.gcdl"(symbol trigger=w158, OFDM symbol index=w157, TX vector=w160, PSDU=w153, input valid=w154) -> (bit=w219, output valid=w220, ready for input=w151, modulation=w221)
    call "802.11 TX IQ Processing.gcdl"(symbol trigger=w158, OFDM symbol index=w157, TX vector=w160, channel selector=w150, start of packet=w159, bit valid=w220, bit=w219, bit processing modulation=w221, DC centered signal=w149, supported bandwidths=w148) -> (data out=w222, output valid=w223)
    call "802.11 TX Data Sink.gcdl"(TX to RF FIFO=w143, internal loopback FIFO=w142, sample=w222, input valid=w223, T2H FIFO="802.11 AFW Resources.grsc\\T2H TX Baseband") -> (T2H FIFO overflow count=w224, TX to RF FIFO overflow count=w225, internal loopback FIFO overflow count=w226)
    $"T2H TX Baseband FIFO overflow" <- w224
    $"TX to RF FIFO overflow" <- w225
    $"compensated CFO" <- w175
    $"internal loopback FIFO overflow" <- w226
    call "802.11 RX Bit Processing Data Sink.gcdl"(PSDU=w192, input valid=w196, FIFO reference="802.11 AFW Resources.grsc\\T2H RX Bit Processing Output") -> (FIFO overflow count=w227)
    $"T2H RX Bit Processing Output FIFO overflow" <- w227
    call "802.11 TX Bit Processing Data Sink.gcdl"(bit=w219, input valid=w220, modulation=w221, FIFO reference="802.11 AFW Resources.grsc\\T2H TX Bit Processing Output") -> (FIFO overflow count=w228)
    $"T2H TX Bit Processing Output FIFO overflow" <- w228
    call "802.11 Capture PHY RX Indications.gcdl"(PHY RX start indication in=w197, PHY RX end indication in=w198) -> (PHY RX start indication out=w229, PHY RX end indication out=w230)
    $"PhyRxStart.ind" <- w229
    $"PhyRxEnd.ind" <- w230
    $"RF input power" <- w207
    Feedback Node(enable?=w174, input=w207) -> w231
    $"RF input power at packet start" <- w231
    $"signal power" <- w203
    Feedback Node(enable?=w174, input=w203) -> w232
    $"signal power at packet start" <- w232
    $"out of range?" <- w205
    FIFO Write(Control Protocol Input=w210, data=w209, reference in=w144)
    $"last applied gain" <- w199
  }
  call "Create Resources.gvi"() -> (config.resources=w233, sync.resources=w234, time.resources=w235)
  clock-driven loop (clock = "40 MHz Onboard Clock") {
    Io Write(data=$"RF 1/Rx/Enable", reference in="RF 1/Rx/Enable")
    Io Write(data=$"RF 0/Tx/Enable", reference in="RF 0/Tx/Enable")
    Io Write(data=$"RF 0/Rx/Enable", reference in="RF 0/Rx/Enable")
    Feedback Node(input=w236) -> w237
    Property Node(instance in=w135) -> ("Gain Settings FIFO"=w238)
    FIFO Read(Control Protocol Input=TRUE, reference in=w238) -> (Control Protocol Output=w236, data=w239)
    Feedback Node(enable?=w236, input=w239) -> w240
    To Fixed Point(number=w240) -> w241: UFXP(6.1) Wrap:Truncate
    # Register Bus and Required Controls/Indicators
    Scale By Power Of 2(n=1, x=w241) -> w242
    To Unsigned Byte Integer(number=w242) -> w243
    Property Node(instance in=T2 {"power enable"=TRUE, "mixer enable"=TRUE, "gain"=0}, "power enable"=$"power enable", "mixer enable"=$"mixer enable", "gain"=w243) -> (instance out=w244)
    call "Set Gain.gcdl"(ATR State=$"ATR State", Radio Control Destination=$"Radio Control Destination", FPGA.Fifo="802.11 AFW Resources.grsc\\AGC Reg Bus 0 Access FIFO", daughterboard=$daughterboard, antenna configuration=$"antenna configuration", Write ATR?=w237, lo lpf enable=$"lo lpf enable", rx.configuration=w244, tx.configuration=$"tx.configuration", spi address=$"spi address", cpld enable=$"cpld enable")
    Io Write(data=$"RF 1/Tx/Enable", reference in="RF 1/Tx/Enable")
    Feedback Node(input=w245) -> w246
    Property Node(instance in=w246) -> ("ready for port 0 input"=w247, "ready for port 1 input"=w248)
    Feedback Node(input=w249) -> w250
    call "niInstr Register Bus v1 FPGA.lvlib__Process.gcdl"(reg.notify host.go rcvd=$"reg.notify host.go rcvd 0", reg.host read.go rcvd=$"reg.host read.go rcvd 0", read completion=w250, reg.reset=$"reg.reset 0", reg.host instruction fifo="niInstr Register Bus v0.grsc\\reg.host instruction fifo 0", ready for output=w248) -> (reg.notify host.go=w251, reg.host read.data=w252, register instruction=w253)
    $"reg.notify host.go 0" <- w251
    $"reg.host read.data 0" <- w252
    FIFO Read(Control Protocol Input=w247, reference in="802.11 AFW Resources.grsc\\AGC Reg Bus 0 Access FIFO") -> (Control Protocol Output=w254, data=w255)
    call "Retrieve FPGA Scoped Instruction.gcdl"(number=w255, valid=w254) -> (output cluster=w256)
    Feedback Node(input=w257) -> w258
    call "niInstr Register Bus v1 FPGA.lvlib__Register Instruction Arbiter (2 inputs).gcdl"(port 0=w256, port 1=w253, reset=FALSE, ready for output=w258) -> (register instr out=w259, ready for input=w245)
    call "Registers.gcdl"(register instruction=w259, config.resources=w233, sync.resources=w234, time.resources=w235) -> (read completion out=w249, ready for input=w257)
    stop if FALSE
  }
  clock-driven loop (clock = "Data Clock") forever {
    # Baseband to/from RF conversion
    # Data Reception from Antenna, downconversion to baseband sample rate, received data will be written into RX baseband input FIFO
    # Reading of TX baseband FIFO, upconversion and transmission to antenna
    Property Node(instance in=w21) -> ("shared properties"=w260, "global timestamp"=w261, "OFDM symbol pulse"=w262)
    call "Mod N Indexer U16 v2.gcdl"(N=$"Data clock cycles per tick (0.1us)", enable=$"data clock locked?") -> (wrap back?=w263)
    call "niInstr Basic Elements v1 FPGA.lvlib__Count Up U32.gcdl"(increment=w263, reset=FALSE) -> (count out=w264)
    Register Write(data=w264, reference in=w261)
    call "Mod N Indexer U16 v2.gcdl"(N=$"Data clock cycles per OFDM symbol", enable=$"data clock locked?") -> (wrap back?=w265)
    Register Write(data=w265, reference in=w262)
    w266 = T19 {"5 MHz"=FALSE, "10 MHz"=FALSE, "20 MHz"=TRUE, "40 MHz"=TRUE, "80 Mhz"=FALSE, "160 MHz"=FALSE}
    w267 = T20 {"format"="a", "channel selector"=0, "device MAC address"=[0, 0, 0, 0, 0, 0], "DC centered signal"=FALSE, "supported bandwidths"={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}}
    Property Node(instance in=w267, "format"=$format, "channel selector"=$"channel selector", "device MAC address"=$"device MAC address", "DC centered signal"=$"DC centered signal", "supported bandwidths"=w266) -> (instance out=w268)
    Register Write(data=w268, reference in=w260)
    $Timestamp <- w264
    Property Node(instance in=w135) -> ("TX to RF FIFO"=w269, "RF to RX FIFO"=w270)
    Build Array($"rx 0.stream enable", $"rx 1.stream enable") -> w271
    w272 = T26 {"0x800000000000", 0, 0, "0x1FFFF", "0x1FFFF", 0, 0, 0, 0, 0, 0, 0}
    Property Node(instance in=w272, "impairments"=$"rx 0.impairments", "frequency shift"=$"rx 0.frequency shift", "phase"=$"rx 0.phase", "output sample rate"=$"rx.output sample rate", "delay"=$"rx.delay") -> (instance out=w273)
    w274 = T26 {"0x800000000000", 0, 0, "0x1FFFF", "0x1FFFF", 0, 0, 0, 0, 0, 0, 0}
    Property Node(instance in=w274, "delay"=$"rx.delay", "output sample rate"=$"rx.output sample rate", "impairments"=$"rx 1.impairments", "frequency shift"=$"rx 1.frequency shift", "phase"=$"rx 1.phase") -> (instance out=w275)
    Build Array(w273, w275) -> w276
    call "802.11 USRP Stream RX.gcdl"(RF to RX FIFO reference=w270, enable DC offset correction=$"enable DC offset correction", rx.reset=$"rx.reset", rx.rf channel=$"rx.rf channel", rx. stream enabled=w271, rx.abort=$"rx.abort", DDC parameters=w276) -> (rx.number of IQ data overflows=w277, rx.dsp reset done=w278, DC average=w279, rx.state=w280, rx.samples processed=w281, rx.number of overflows=w282)
    $"rx.number of IQ data overflows" <- w277
    Build Array($"tx 0.stream enable", $"tx 1.stream enable") -> w283
    w284 = T27 {0, "0x1FFFF", "0x1FFFF", 0, 0, 0, 0, 0, 0, 0, 0, "0x200000", "0x200000", 0}
    Property Node(instance in=w284, "gain"=$"tx 0.gain", "frequency shift"=$"tx 0.frequency shift", "phase"=$"tx 0.phase", "impairments"=$"tx 0.impairments", "input sample rate"=$"tx.input sample rate", "delay"=$"tx.delay") -> (instance out=w285)
    w286 = T27 {0, "0x1FFFF", "0x1FFFF", 0, 0, 0, 0, 0, 0, 0, 0, "0x200000", "0x200000", 0}
    Property Node(instance in=w286, "delay"=$"tx.delay", "input sample rate"=$"tx.input sample rate", "gain"=$"tx 1.gain", "frequency shift"=$"tx 1.frequency shift", "phase"=$"tx 1.phase", "impairments"=$"tx 1.impairments") -> (instance out=w287)
    Build Array(w285, w287) -> w288
    call "802.11 USRP Stream TX.gcdl"(tx.enable streams=w283, tx.reset=$"tx.reset", tx.rf channel=$"tx.rf channel", TX to RF FIFO reference=w269, tx.abort=$"tx.abort", DUC parameters=w288) -> (tx.state=w289, tx.samples processed=w290, tx.underflows=w291, tx.number of IQ data overflows=w292, tx.dsp reset done=w293)
    $"tx.state" <- w289
    $"rx.dsp reset done" <- w278
    $"tx.samples processed" <- w290
    $"rx.state" <- w280
    $"tx.underflows" <- w291
    $"rx.samples processed" <- w281
    $"tx.number of IQ data overflows" <- w292
    $"rx.number of overflows" <- w282
    $"tx.dsp reset done" <- w293
    $"DC average" <- w279
  }
  call "LEDs.gvi"()
  call "niUsrpRio Config v1 FPGA.lvlib__Process.gvi"(resources=w233)
