vi "Print all traces.gvi"   [LabVIEW Communications System Design Suite 2.0.1]
inputs:
  "custom session": "Custom session.gtype"
  "CCA Busy trace filepath": path
  "start printing?": bool
  "error in": error
  "Timing Control trace filepath": path
outputs:
  "error out": error
types:
  T1 = cluster{"Timestamp": u32, "Timing Control State Enum": u32}
  "Custom session.gtype" = cluster{"H2T TX Data FIFO: actual depth": u32, "Track CCA Busy queue": Queue<cluster{"Timestamp": u32, "Busy or Idle": u32}>, "Track Timing Control queue": Queue<T1>}
diagram:
  Property Node(instance in=$"custom session") -> ("Track CCA Busy queue"=w1, "Track Timing Control queue"=w2)
  case ($"start printing?") {
    frame False, Default {
      w3 = $"error in"
    }
    frame True {
      Flush Queue(error in=$"error in", queue=w1) -> (error out=w4, remaining elements=w5)
      for {
        w6 = each element of w5
        Property Node(instance in=w6) -> ("Timestamp"=w7, "Busy or Idle"=w8)
        To Unsigned Long Integer(number=w7) -> w9
        Build Array(w9, w8) -> w10
        To Quad Integer(number=w10) -> w11
        call "Write to Spreadsheet File (I64).gvi"(file path=$"CCA Busy trace filepath", 1D data=w11, append to file?=TRUE, delimiter=",", transpose?=FALSE, format="%d")
      }
      Flush Queue(error in=$"error in", queue=w2) -> (error out=w12, remaining elements=w13)
      Merge Errors(w4, w12) -> (error out=w3)
      for {
        w14 = each element of w13
        Property Node(instance in=w14) -> ("Timestamp"=w15, "Timing Control State Enum"=w16)
        To Unsigned Long Integer(number=w15) -> w17
        Build Array(w17, w16) -> w18
        To Quad Integer(number=w18) -> w19
        call "Write to Spreadsheet File (I64).gvi"(file path=$"Timing Control trace filepath", 1D data=w19, append to file?=TRUE, delimiter=",", transpose?=FALSE, format="%d")
      }
    }
  }
  $"error out" <- w3
